# Grasshopper definition Tested Algorithm.gh (Grasshopper 1.0.7)
# Copyright: LA
# plug-ins: Ambrosinus Toolkit, LadybugGrasshopper

# ----
# 3D Model to Rendering Algo
button = Button()
file_path = FilePath("D:\OneDrive\Desktop\Screenshot\")
viewcapture = ViewCapture(
    DirectoryPath=file_path,
    ImageFormat=Slider(0, range=0..1),
    ImageFilename="raw render {0}.png",
    ScaleFactor=Slider(1, range=0..10),
    Run=button)  # -> ImagePath, ImagesList
# 4
number_slider = Slider(0, range=0..10)
item = ListItem(List=viewcapture.ImagesList, Index=number_slider, Wrap=True)
panel = Panel(viewcapture.ImagePath)
panel_2 = Panel(item)
panel_3 = Panel(viewcapture.ImagesList)
imageviewer = LBImageViewer(ImagePath_=viewcapture.ImagePath, _scale_=1.5, DisableClickable=False, SaveImgWithCoords=False, scale=1.5)  # -> ImagePath, Values, GIF

# ----
# 1
# Local Stable Diffusion via Automatic 1111
cmdargs = CMDArguments({"API": 1, "lowvram": 2, "xformers": 3, "autolaunch": 4, "theme dark": 5, "share": 6, "listen": 7, "reinstall xformers": 8, "reinstall torch": 9, "skip vers check": 10, "precision full": 11, "no half": 12, "no half vae": 13, "disable NaN check": 14, "upcast sampling": 15}, selected=["API", "xformers"])
gen = Button()
start = Button()
close = Button()
check = Button()
checkip = Button()
custom_port = Panel("7869")
path = FilePath("E:\Automatic 1111\webui\")
la_launchsd_loc = LaunchSD_loc(
    DirectoryPath=path,
    CmdArguments=cmdargs,
    IPPort=7860,
    GenWebui=gen,
    StartProcess=start,
    CloseProcess=close,
    CheckProcess=check,
    CheckIPconfig=checkip,
    Expression0="1",
    Expression1="2",
    Expression10="11",
    Expression11="12",
    Expression12="13",
    Expression13="14",
    Expression14="15",
    Expression2="3",
    Expression3="4",
    Expression4="5",
    Expression5="6",
    Expression6="7",
    Expression7="8",
    Expression8="9",
    Expression9="10",
    Name0="API",
    Name1="lowvram",
    Name10="precision full",
    Name11="no half",
    Name12="no half vae",
    Name13="disable NaN check",
    Name14="upcast sampling",
    Name2="xformers",
    Name3="autolaunch",
    Name4="theme dark",
    Name5="share",
    Name6="listen",
    Name7="reinstall xformers",
    Name8="reinstall torch",
    Name9="skip vers check")
panel_4 = Panel(la_launchsd_loc)

# ----
# 4
path_2 = FilePath()
la_imgconv = ImgConv(PathIMG=path_2, Ftype=5, Run=False)  # -> ConvIMG, Info, Width, Height
B = ValueList({"Increase": 1, "Decrease": 0}, selected="Increase")
division = Division(A=la_imgconv.Width, B=la_imgconv.Height)
cluster = Cluster(opt=B, ratio=division, A=Slider(1024, range=0..10000))  # -> size_a, size_b
panel_5 = Panel(cluster.size_a)
panel_6 = Panel(cluster.size_b)
number_slider_2 = Slider(1, range=0..8)
list = ValueList({"Resize multipl": 0, "Custom size": 1}, selected="Custom size")
path_3 = FilePath("D:\Desktop\ATk_CN\Resize\")
la_upsclai_loc = UpsclAI_loc(
    Mode=list,
    TimeoutCustom=10,
    CheckSDupscalers=Toggle(True),
    IDUspcales1=Slider(7, range=0..8),
    IDUspcales2=0,
    DirectoryPath=path_3,
    BaseImagePath=path_2,
    Resize=Slider(3, range=0..10),
    Width=panel_6,
    Height=panel_5,
    StartProcess=Toggle(False))  # -> UpscalersList, ImageUpsPath
la_opendir = OpenDir(DirectoryPath=path_3, Open=Button())
ups_models_list = Panel(la_upsclai_loc.UpscalersList)
ups_full_path = Panel(la_upsclai_loc.ImageUpsPath)

path_4 = FilePath("D:\Desktop\SDlocalCNv11\stable-diffusion-webui\")
panel_7 = Panel(path)

# ----
# 2
number_slider_3 = Slider(10, range=0..20)
# Model List
toggle = BooleanToggle(True)
la_sdopts_loc = SDopts_loc(CheckSDmodels=toggle, IDSDModels=number_slider_3, StartProcess=Toggle(True))
sd_models_list = Panel(la_sdopts_loc)

# ----
# Main Algorithm
prompt = Panel("Create a highly detailed, ultra-realistic 3D illustration of a cutting-edge multimedia speaker, placed centrally on a sleek, modern table. The speaker design should be futuristic and sophisticated, with glossy black and metallic silver finishes, accentuated by subtle neon blue lighting. The table, with a reflective glass surface, beautifully mirrors the speaker, enhancing its intricate design details. The ambient lighting is soft yet focused, highlighting the speaker's dynamic contours and casting a gentle glow on the surrounding area. The background is intentionally blurred, ensuring the speaker remains the focal point, while giving a hint of a high-tech, minimalist interior. The overall mood is elegant and contemporary, exuding a sense of advanced technology and premium quality, perfect for a showcase in a modern home or tech gallery.")
negative_prompt = Panel("Watermark, Text, censored, deformed, bad anatomy, disfigured, poorly drawn face, mutated, extra limb, ugly, poorly drawn hands, missing limb, floating limbs, disconnected limbs, disconnected head, malformed hands, long neck, mutated hands and fingers, bad hands, missing fingers, cropped, worst quality, low quality, mutation, poorly drawn, huge calf, bad hands, fused hand, missing hand, disappearing arms, disappearing thigh, disappearing calf, disappearing legs, missing fingers, fused fingers, abnormal eye proportion, Abnormal hands, abnormal legs, abnormal feet,  abnormal fingers")
cn_v1_1_mode = ValueList({"T2I Basic": 0, "T2I CN_canny": 1, "T2I CN_depth_leres": 2, "T2I CN_depth_midas": 3, "T2I CN_depth_zoe": 4, "T2I CN_lineart_anime": 5, "T2I CN_lineart_coarse": 6, "T2I CN_lineart_realistic": 7, "T2I CN_lineart_standard (from white bg & black line)": 8, "T2I CN_mlsd": 9, "T2I CN_normal_bae": 10, "T2I CN_normal_midas": 11, "T2I CN_openpose": 12, "T2I CN_openpose_face": 13, "T2I CN_openpose_faceonly": 14, "T2I CN_openpose_full": 15, "T2I CN_openpose_hand": 16, "T2I CN_scribble_hed": 17, "T2I CN_scribble_pidinet": 18, "T2I CN_scribble_xdog": 19, "T2I CN_seg_ofade20k": 20, "T2I CN_seg_ofcoco": 21, "T2I CN_seg_ufade20k": 22, "T2I CN_shuffle": 23, "T2I CN_softedge_hed": 24, "T2I CN_softedge_hedsafe": 25, "T2I CN_softedge_pidinet": 26, "T2I CN_softedge_pidisafe": 27, "T2I CN_tile_gaussian": 28}, selected="T2I CN_mlsd")
B_2 = ValueList({"Increase": 1, "Decrease": 0}, selected="Increase")
cn_v1_0_mode = ValueList({"T2I Basic": 0, "T2I CN-canny": 1, "T2I CN-depth": 2, "T2I CN-depth_leres": 3, "T2I CN-hed": 4, "T2I CN-mlsd": 5, "T2I CN-normal_map": 6, "T2I CN-openpose": 7, "T2I CN-openpose_hand": 8, "T2I CN-scribble": 9, "T2I CN-fake_scribble": 10, "T2I CN-segment": 11}, selected="T2I CN-depth")
path_5 = FilePath(viewcapture.ImagePath)
la_imgconv_2 = ImgConv(PathIMG=path_5, Ftype=5, Run=False)  # -> ConvIMG, Info, Width, Height
division_2 = Division(A=la_imgconv_2.Width, B=la_imgconv_2.Height)
path_6 = FilePath("D:\OneDrive\Desktop\Output\")
list_2 = ValueList({"Just Resize": 0, "Scale to Fit (Inner Fit)": 1, "Envelope (Outer Fit)": 2}, selected="Just Resize")
number_slider_4 = Slider(123456, range=0..1000000)
list_3 = ValueList({"CN v1.0": 0, "CN v1.1.X": 1}, selected="CN v1.0")
list_4 = ValueList({"Euler a": 0, "Euler": 1, "LMS": 2, "Heun": 3, "DPM2": 4, "DPM2 a": 5, "DPM++ 2S a": 6, "DPM++ 2M": 7, "DPM++ SDE": 8, "DPM fast": 9, "DPM adaptive": 10, "LMS Karras": 11, "DPM2 Karras": 12, "DPM2 a Karras": 13, "DPM++ 2S a Karras": 14, "DPM++ 2M Karras": 15, "DPM++ SDE Karras": 16, "DDIM": 17, "PLMS": 18, "UniPC": 19}, selected="DDIM")
imageviewer_2 = LBImageViewer(ImagePath_=path_5, _scale_=1.5, DisableClickable=False, SaveImgWithCoords=False, scale=1.5)  # -> ImagePath, Values, GIF

cluster_2 = Cluster(opt=B_2, ratio=division_2, A=Slider(512, range=0..1000))  # -> size_a, size_b
panel_8 = Panel(cluster_2.size_a)
panel_9 = Panel(cluster_2.size_b)

# ----
# 3
la_aitxttoimgv1_loc = AItxtToimgV1_loc(
    CNVersion=list_3,
    ModePretrained=cn_v1_0_mode,
    TimeoutCustom=Slider(25, range=0..100),
    DirectoryPath=path_6,
    BaseImagePath=path_5,
    Prompt=prompt,
    NegativePrompt=negative_prompt,
    Steps=Slider(13, range=0..60),
    CfgScale=Slider(7.3, range=0..30),
    Weight=Slider(0.93, range=0..1),
    GuidanceStart=Slider(0.04, range=0..1),
    GuidanceEnd=Slider(1, range=0..1),
    Width=cluster_2.size_a,
    Height=cluster_2.size_b,
    Resize=list_2,
    NumberImgs=Slider(1, range=1..5),
    SamplerModel=list_4,
    Seed=0,
    Start=Toggle(True))  # -> Output, InfoSettings

la_seeout = SeeOut(Output=la_aitxttoimgv1_loc.Output, ID=Slider(268, range=0..269))  # -> SeqOut, LastOut
imageviewer_3 = LBImageViewer(ImagePath_=la_seeout.SeqOut, _scale_=1.5, DisableClickable=False, SaveImgWithCoords=False, scale=1.5)  # -> ImagePath, Values, GIF
la_sd_imginfo = SDImginfo(ImgPath=imageviewer_3.ImagePath)
image_info = Panel(la_sd_imginfo)

# ==== cluster Cluster
opt = ClusterInput()
ratio = ClusterInput()
A = ClusterInput()
num = Number(ratio)
multiplication = Multiplication(A=A, B="1")
multiplication_2 = Multiplication(A=A, B=num)
division = Division(A=A, B=num)
filter = StreamFilter(Gate=opt, Stream0=division, Stream1=multiplication_2)
round = Round(Number=filter)  # -> Nearest, Floor, Ceiling
size_a = ClusterOutput(multiplication)
size_b = ClusterOutput(round.Nearest)
